# Grasshopper definition Cantilever.gh (Grasshopper 1.0.8)
# plug-ins: Bifocals, FEMur

unit_z = UnitZ(Factor=Slider(10, range=0..10))
point = Point(Point(0, 0, 0))
linear_array = LinearArray(Geometry=point, Direction=unit_z, Count=10)  # -> Geometry, Transform
number_slider = Slider(200, range=0..1000)
node_femur = NodeFEMur(Points=linear_array.Geometry)
panel = Panel(node_femur)
crosssection_h_femur = CrossSectionHFEMur(Id=0, Name="H-Section", B=number_slider, H=number_slider, T_f=Slider(12, range=0..100), T_w=Slider(8, range=0..10), R=6)
material_femur = MaterialFEMur(Id=0)
split_list = SplitList(List=node_femur, Index=Slider(9, range=0..10))  # -> ListA, ListB
split_list_2 = SplitList(List=node_femur, Index=Slider(1, range=0..1))  # -> ListA, ListB
panel_2 = Panel(crosssection_h_femur)
beamelement_femur = BeamElementFEMur(INodes=split_list.ListA, JNodes=split_list_2.ListB, Material=material_femur, CrossSection=crosssection_h_femur)
panel_3 = Panel(beamelement_femur)
